# Dynamo graph APM_CenterRoomTags.dyn (Dynamo 2.5.0.7460)
# packages: Modelical 2022.6.15

# note: INSTRUCTIONS:
# This definition takes all the rooms and places their center at the centroid of the room.
categories = Categories("OST_Rooms")
all_elements_of_category = ElementsOfCategory(Category=categories)

# group: Modelical _______________
centerLocationAndTags = Custom[Room.CenterLocationAndTags](rooms=all_elements_of_category)  # package Modelical; This node moves the room location of the selected rooms to the closest possible point to geometrical center. Also modifies the associated room tags in all model.
