# Dynamo graph APM_ChangeCase.dyn (Dynamo 2.5.0.7460)

# group: CHOOSE CATEGORY: ------------------
# note: INSTRUCTIONS:
# Definition created to change from lowercase to uppercase  in elements by categories.
category_to_change = Categories("OST_Views")  # graph input
all_elements_of_category = ElementsOfCategory(Category=category_to_change)

parameter_to_change = StringInput("Nombre de vista")  # graph input
getParameterValueByName = Element.GetParameterValueByName(element=all_elements_of_category, parameterName=parameter_to_change)
boolean = BoolSelector(true)
changeCase = String.ChangeCase(str=getParameterValueByName, upper=boolean)

# group: TO REVIT: ----------
setParameterByName = Element.SetParameterByName(element=all_elements_of_category, parameterName=parameter_to_change, value=changeCase)  # graph output
