# Dynamo graph APM_ColumnsTags.dyn (Dynamo 2.5.0.7460)
# packages: spring nodes 204.1.0

current = Document.Current()
# note: Custom Node: spring nodesv.204.1.0
ꟿ_document_activeview = Custom[ꟿ Document.ActiveView](refresh=current)  # package spring nodes; Selects the current document's active view. Supports more view types than the built-in option. Will be depreciated once the bult in node works with all plan types.

# group: SELECTING ALL ELEMENT IN ACTIVE VIEW: ----------
# note: INSTRUCTIONS:
# This definition is used to tag specific elements such as doors or pillars (that are not longitudinal such as walls or beams). If we are going to tag doors we join the Element.GetLocation directly without doing the translate
all_elements_in_active_view = ElementsInView()
getCategory = Element.GetCategory(element=all_elements_in_active_view)
string_from_object = FromObject(obj=getCategory)

# group: FILTERING THE CATEGORY: -------------
category_name = CodeBlock { "Pilares estructurales"; }
eq = string_from_object == category_name
filterByBoolMask = List.FilterByBoolMask(list=all_elements_in_active_view, mask=eq)

# group: GET LOCATION: --------------
getLocation = Element.GetLocation(element=filterByBoolMask.in)
YAxis = Vector.YAxis()
number_slider = DoubleSlider(0.3, range=0..1 step 0.1)
translate = Geometry.Translate(geometry=getLocation, direction=YAxis, distance=number_slider)

# group: TO REVIT: -----------
byElementAndLocation = Tag.ByElementAndLocation(view=ꟿ_document_activeview, element=filterByBoolMask.in, location=translate)
