# Dynamo graph APM_DeleteFamilyParameters.dyn (Dynamo 2.5.0.7460)
# packages: Data-Shapes 2022.2.105

code_block = CodeBlock { "SELECT PARAMETERS"; }
code_block_2 = CodeBlock { "DELETE PARAMETERS"; }
# note: INSTRUCTIONS:
# This script is for DynamoPlayer. The aim is to delete all parameters selected by the check marc all at once.
code_block_3 = CodeBlock { "PARAMETERS"; }
get_all_parameters = Python()  # unwired: IN[0]
# ---------- get_all_parameters.python (20 lines) ----------
# Copyright(c) 2018, Petar Penchev
# @All 1 Studio, http://all1studio.com

import clr
clr.AddReference('RevitAPI')
from Autodesk.Revit.DB import*
import Autodesk

clr.AddReference("RevitServices")
import RevitServices
from RevitServices.Persistence import DocumentManager

doc=DocumentManager.Instance.CurrentDBDocument

mgr=doc.FamilyManager
params=mgr.Parameters
paramsNames=[]
for p in params:
	paramsNames.append(p.Definition.Name)
OUT=paramsNames
# ----------------------------------------
window_height = DoubleSlider(350, range=100..2000 step 10)  # graph input
# note: Custom Node: Data-Shapesv.2022.2.105
listview_data = Custom[Listview Data](InputName=code_block_3, Keys=get_all_parameters, Values=get_all_parameters, Height_optionnal=window_height)  # package Data-Shapes; Create data for ListView input in UI.MultiInputForm ++ . Check out www.data-shapes.net for more infos.
run = BoolSelector(true)  # graph input
code_block_4 = CodeBlock { "CANCEL"; }
multipleinputform = Custom[MultipleInputForm ++](Description_optional=code_block, ButtonText_optional=code_block_2, Inputs=listview_data, Toggle=run, CancelButtonText_optional=code_block_4)  # package Data-Shapes; Create a form with multiple inputs. see www.data-shapes.net for tutorials and infos!
code_block_5 = CodeBlock(LIST=multipleinputform.User_Inputs) { LIST[0]; }
delete_selected_parameters = Python(IN[0]=code_block_5)
# ---------- delete_selected_parameters.python (31 lines) ----------
# Copyright(c) 2018, Petar Penchev
# @All 1 Studio, http://all1studio.com

import clr
clr.AddReference('RevitAPI')
from Autodesk.Revit.DB import*
import Autodesk

clr.AddReference("RevitServices")
import RevitServices
from RevitServices.Persistence import DocumentManager
from RevitServices.Transactions import TransactionManager
from Autodesk.Revit.DB import Transaction

doc=DocumentManager.Instance.CurrentDBDocument

paramNames=IN[0]
paramToDel=[]

for n in paramNames:
	paramToDel.append(doc.FamilyManager.get_Parameter(n))

TransactionManager.Instance.EnsureInTransaction(doc)	
for p in paramToDel:
	try:
		doc.Delete(p.Id)
	except:
		pass	
TransactionManager.Instance.TransactionTaskDone()

OUT=paramToDel
# ----------------------------------------
