# Dynamo graph APM_DeleteFillPattern.dyn (Dynamo 2.5.0.7460)
# packages: archi-lab.net 2023.213.1722

# note: INSTRUCTIONS:
# With this script we can delete all the filling patterns that we indicate in the list that it will generate, all at once.
element_types = ElementTypes("FillPatternElement")
all_elements_of_type = ElementsOfType(element_type=element_types)
# note: Custom Node: archilab v.2023.213.1722
isSolidFill = archilab.Revit.Elements.FillPatterns.IsSolidFill(fillPattern=all_elements_of_type)
filterByBoolMask = List.FilterByBoolMask(list=all_elements_of_type, mask=isSolidFill)
name = Element.Name(element=filterByBoolMask.out)
list_selector = ListSelector(List_3=name)  # unwired: List, List_2
dropdown_list_selector = DropdownListSelector(List_3=name, ItemsCollection=[{Name: "Diagonal arriba", Index: 0, IsSelected: true}, {Name: "Diagonal abajo", Index: 1, IsSelected: true}, {Name: "Horizontal", Index: 2, IsSelected: false}, {Name: "Vertical", Index: 3, IsSelected: true}, {Name: "Sombreado de líneas cruzadas", Index: 4, IsSelected: true}, {Name: "Sombreado de líneas cruzadas diagonal", Index: 5, IsSelected: true}])  # unwired: List, List_2
indexOf = List.IndexOf(list=name@L2, element=dropdown_list_selector.out2, lacing=Shortest)
getItemAtIndex = List.GetItemAtIndex(list=filterByBoolMask.out, index=indexOf)
delete = archilab.Revit.Elements.Elements.Delete(element=getItemAtIndex)
