# Dynamo graph APM_DeleteLinePatterns.dyn (Dynamo 2.5.0.7460)
# packages: archi-lab.net 2023.213.1722

# group: SELECT ALL LINE PATTERNS IN THE PROJECT: -----------------
# note: INSTRUCTIONS:
# Definition created to delete all selected line patterns at once.
# Is very usefull when we had imported a lot of dwg files and we have to delete all the line patterns created by this.
# -CAUTION-
# You can delete used line patterns.
element_types = ElementTypes("LinePatternElement")
all_elements_of_type = ElementsOfType(element_type=element_types)
name = Element.Name(element=all_elements_of_type)

# note: Custom Node: archilab v.2023.213.1722
list_selector = ListSelector(List_2=name)  # unwired: List
indexOf = List.IndexOf(list=name, element=list_selector.out1)
getItemAtIndex = List.GetItemAtIndex(list=all_elements_of_type, index=indexOf)

# group: DELETE: --------
# note: Custom Node: archilab v.2023.213.1722
delete = archilab.Revit.Elements.Elements.Delete(element=getItemAtIndex)
