# Dynamo graph APM_DoorSwingTag.dyn (Dynamo 2.5.0.7460)
# packages: archi-lab.net 2023.213.1722

# note: INSTRUCTIONS:
# This definition is designed to place a mark that indicates the distance of the doors: right or left.
# To do this, what we do is place a D-opening to the right or an I-opening to the left in the Comments parameter.
categories = Categories("OST_Doors")
all_elements_of_category = ElementsOfCategory(Category=categories)
select_phase = RevitPhases("Nueva construcción")
door_set_handing = Custom[Door Set Handing](door=all_elements_of_category, phase=select_phase)  # package archi-lab.net; Determines door set handing (whether its a left or right handed door). Input takes doors, and output will split them into two lists (right and left).
list_create = List.Create(item0=door_set_handing.leftHanded, item1=door_set_handing.leftHandedReversed)
getLocation = Element.GetLocation(element=list_create)
clear_list = Custom[Clear List](input=getLocation)  # package archi-lab.net; This node will remove all Null and Empty Lists from any list.
list_create_2 = List.Create(item0=door_set_handing.rightHanded, item1=door_set_handing.rightHandedReversed)

# group: PLACE IN PARAMETER "COMMETS": ______________________________________
string = StringInput("Comentarios")
string_2 = StringInput("I")
setParameterByName = Element.SetParameterByName(element=list_create_2, parameterName=string, value=string_2)
string_3 = StringInput("D")
setParameterByName_2 = Element.SetParameterByName(element=list_create, parameterName=string, value=string_3)

getLocation_2 = Element.GetLocation(element=list_create_2)
clear_list_2 = Custom[Clear List](input=getLocation_2)
