# Dynamo graph APM_Duplicate&RenameViews.dyn "Duplicar+Renombrar-Vistas" (Dynamo 2.5.0.7460)
# packages: spring nodes 204.1.0, Clockwork for Dynamo 1.x 1.34.0

# note: Custom Node: spring nodesv.204.1.0
# note: Select views to duplicate:
ꟿ_collect_currentselection = Custom[ꟿ Collect.CurrentSelection]()  # package spring nodes; Gets the currently selected elements. Connect a boolean switch to refresh the selection.
# note: Custom Node: Clockwork
duplicate = Custom[View.Duplicate](view=ꟿ_collect_currentselection)  # package Clockwork for Dynamo 1.x; Duplicates a given view
count = List.Count(list=ꟿ_collect_currentselection)
code_block = CodeBlock(CANT=count) { 1..#CANT..1; }

# group: VIEW NAME: -------------
code_block_2 = CodeBlock(nomb=code_block) { "NI_" + nomb +"_car"; }

# group: TO REVIT: -----------
# note: Custom Node: Clockwork
setName = Custom[Element.SetName](element=duplicate, name=code_block_2)  # package Clockwork for Dynamo 1.x; Gets the name of a given Revit element
