# Dynamo graph APM_Floors&WallsLegend.dyn "APM_FloorsLegend" (Dynamo 2.5.0.7460)
# packages: Clockwork for Dynamo 1.x 1.31.1

# group: REFERENCE ELEMENTS: --------------------
select_floor_wall_sample = DSModelElementsSelection()  # 1 picked in the model
select_text_sample = DSModelElementsSelection()  # 1 picked in the model
list_create = List.Create(item0=select_text_sample, item1=select_floor_wall_sample)

# group: SECLECT ALL THE FLOORS/WALLS IN THE PROJECT: -------------------
# note: INSTRUCTIONS:
# All floor/wall types from the entire project are selected and a floor and a sample text (any) are placed in the legend that we create for this purpose.
categories = Categories("OST_Walls")
all_elements_of_category = ElementsOfCategory(Category=categories)
elementType = Element.ElementType(element=all_elements_of_category)
uniqueItems = List.UniqueItems(list=elementType)
boolean = BoolSelector(false)
clean = List.Clean(list=uniqueItems, preserveIndices=boolean)

# group: NUMBER OF FLOORS AND SPACING: ------------------
count = List.Count(list=clean)
code_block = CodeBlock { 0.5; }
code_block_2 = CodeBlock(COUNT=count, SPACING=code_block) { (COUNT-1)*(SPACING*-1); (COUNT-1); }

# group: Punto medio del muro y lo colocamos a la longitud total donde estarán divididos los tipos de muros -----------------------------
geometry = Element.Geometry(element=select_floor_wall_sample)
centroid = Solid.Centroid(solid=geometry)
translate = Geometry.Translate(geometry=centroid, yTranslation=code_block_2.out0)

# group: DIVIDING SEGMENTS --------------------------------
byStartPointEndPoint = Line.ByStartPointEndPoint(startPoint=centroid, endPoint=translate)
pointsAtEqualSegmentLength = Curve.PointsAtEqualSegmentLength(curve=byStartPointEndPoint, divisions=code_block_2.out1)
join = List.Join(list0=pointsAtEqualSegmentLength, list1=translate)
boolean_2 = BoolSelector(false)
clean_2 = List.Clean(list=join, preserveIndices=boolean_2)
flatten = List.Flatten(list=clean_2)
byTwoPoints = Vector.ByTwoPoints(start=centroid, end=flatten@L1, lacing=CrossProduct)

boolean_3 = BoolSelector(false)
clean_3 = List.Clean(list=byTwoPoints, preserveIndices=boolean_3)

# group: COPY REFERENCE ELEMENTS: ------------
# note: No coge los elementos organizados
copyByVector = Custom[Element.CopyByVector](element=list_create, vector=byTwoPoints)  # package Clockwork for Dynamo 1.x; Copies an element or a list of elements by a given vector.

# group: PARAMETERS: ----------------
firstItem = List.FirstItem(list=copyByVector@L2, lacing=Longest)
list_join_elements = List.Join(list0=select_floor_wall_sample, list1=firstItem)
code_block_3 = CodeBlock { "Tipo de componente"; }
lastItem = List.LastItem(list=copyByVector@L2, lacing=Longest)
list_join_texts = List.Join(list0=select_text_sample, list1=lastItem)

# group: WALLS BY TYPE MARK --------------------------
code_block_4 = CodeBlock { "Marca de tipo"; }
getParameterValueByName = Element.GetParameterValueByName(element=clean, parameterName=code_block_4)
sortByKey = List.SortByKey(list=clean, keys=getParameterValueByName)

# group: ELEMENTS: -----------
setParameterByName = Element.SetParameterByName(element=list_join_elements, parameterName=code_block_3, value=sortByKey.sorted_list)

# group: TYPE MARK: ----------
setText = TextNote.SetText(textNote=list_join_texts, value=sortByKey.sorted_keys)
