# Dynamo graph APM_LegendToSheets.dyn (Dynamo 2.5.0.7460)
# packages: SteamNodes 1.2.4, Rhythm 2020.2.13, Clockwork for Dynamo 1.x 1.34.0

# group: SELECT VIEWPORTS: ___________________
categories = Categories("OST_Viewports")
all_elements_of_category = ElementsOfCategory(Category=categories)

# group: SELECT VIEW LEGEND (previusly place in the first sheet): ______________________
code_block = CodeBlock { "Nombre de vista"; }
getParameterValueByName = Element.GetParameterValueByName(element=all_elements_of_category, parameterName=code_block)
write_the_legend_view_name = CodeBlock { "NOTAS-ACC-Edif Hospital"; }
eq = getParameterValueByName == write_the_legend_view_name
filterByBoolMask = List.FilterByBoolMask(list=all_elements_of_category, mask=eq)

# group: SELECT & FILTER SHEETS: ________________________
# note: INSTRUCTIONS:
# This script is to place an specific legend to multiple sheets.
# First you need to place the legend in the first sheet.
# Need to select the legend view by writing the legend view name
categories_2 = Categories("OST_Sheets")
all_elements_of_category_2 = ElementsOfCategory(Category=categories_2)
code_block_2 = CodeBlock { "F2"; }
name = Element.Name(element=all_elements_of_category_2)
restOfItems = List.RestOfItems(list=all_elements_of_category_2)

# group: OPTION FILTERING BY SHEET NUMBER: ----------------------------------
code_block_3 = CodeBlock { "Número de plano"; }
getParameterValueByName_2 = Element.GetParameterValueByName(element=all_elements_of_category_2, parameterName=code_block_3)
string_from_object = FromObject(obj=getParameterValueByName_2)

# group (continued): SELECT & FILTER SHEETS: ________________________
contains = String.Contains(str=string_from_object, searchFor=code_block_2, lacing=CrossProduct)
filterByBoolMask_2 = List.FilterByBoolMask(list=all_elements_of_category_2, mask=contains)
# note: Custom Node: Clockwork v.1.34.0
anyTrue = Custom[Booleans.AnyTrue](seq=contains)  # package Clockwork for Dynamo 1.x; Returns true if any item in a list of booleans is true.

# group: LEGEND CENTROID: __________________
# note: Custom Node: SteamNodes v.1.2.4
viewPortBoxCenter = Custom[View.ViewPortBoxCenter](filterByBoolMask.in)  # package SteamNodes; Get ViewPort Box center point

# group: VIEWPORTS: ________________
count = List.Count(list=filterByBoolMask_2.in)
ofRepeatedItem = List.OfRepeatedItem(item=filterByBoolMask.in, amount=count)
flatten = List.Flatten(list=ofRepeatedItem)
# note: Custom Node: Rhythm v.2020.2.13
ʳʰʸᵗʰᵐ_viewport_getview = Rhythm.Revit.Elements.Viewport.GetView(viewport=flatten)
ofRepeatedItem_2 = List.OfRepeatedItem(item=viewPortBoxCenter, amount=count)
flatten_2 = List.Flatten(list=ofRepeatedItem_2)
# note: Custom Node: SteamNodes v.1.2.4
placeViewsOnExistingSheets = Custom[Tool.PlaceViewsOnExistingSheets](Sheet=filterByBoolMask_2.in, View=ʳʰʸᵗʰᵐ_viewport_getview, flatten_2)  # package SteamNodes; Place the views on the sheets at the points you provide.

element_types = ElementTypes("ElementType")
all_elements_of_type = ElementsOfType(element_type=element_types)
name_2 = Element.Name(element=all_elements_of_type)
code_block_4 = CodeBlock { "Sin titulo"; }
contains_2 = List.Contains(list=name_2@L1, item=code_block_4)
filterByBoolMask_3 = List.FilterByBoolMask(list=all_elements_of_type, mask=contains_2)

# group: TO REVIT: -------------
list_create = List.Create(item0=filterByBoolMask.out, item1=placeViewsOnExistingSheets)
flatten_3 = List.Flatten(list=list_create)
code_block_5 = CodeBlock { "Tipo"; }
setParameterByName = Element.SetParameterByName(element=flatten_3, parameterName=code_block_5, value=filterByBoolMask_3.in)
