# Dynamo graph APM_LevelsByHeight+Name.dyn (Dynamo 2.5.0.7460)

number_of_levels = IntegerSlider(20, range=1..100 step 1)  # graph input
levels_height = DoubleSlider(4.25, range=3..20 step 0.1)  # graph input
heights = CodeBlock(numlevels=number_of_levels, height=levels_height) { 0..#numlevels..height; }
levels = CodeBlock(numlevels=number_of_levels) { 0..#numlevels..1; }
levels_names = CodeBlock(numlevel=levels) { "Level_" + numlevel; }
byElevationAndName = Level.ByElevationAndName(elevation=heights, name=levels_names)  # graph output
