# Dynamo graph APM_LinePatternPrefix.dyn (Dynamo 2.5.0.7460)
# packages: Clockwork for Dynamo 1.x 1.31.1

# group: SELECT ALL THE LINE PATTERNS IN THE PROJECT: ------------
# note: INSTRUCTIONS:
# This script is designed to add a prefix/sufix to Revit Line patterns.
element_types = ElementTypes("LinePatternElement")
all_elements_of_type = ElementsOfType(element_type=element_types)
name = Element.Name(element=all_elements_of_type)

# group: PREFIX/SUFIX: --------------
code_block = CodeBlock { "VP_"; }
code_block_2 = CodeBlock(pre=code_block, name=name) { pre + name; }

# group: VARIATION TO CHANGE THE PREFIX/SUFIX: ----------
code_block_3 = CodeBlock { "MIO"; }
replace = String.Replace(str=name, searchFor=code_block, replaceWith=code_block_3)

# group: TO REVIT: -----------
# note: Custom Node: Clockwork
setName = Custom[Element.SetName](element=all_elements_of_type, name=replace)  # package Clockwork for Dynamo 1.x; Gets the name of a given Revit element
