# Dynamo graph APM_LineStyles.dyn (Dynamo 2.5.0.7460)
# packages: bimorphNodes 3.0.3

# group: LINE STYLE NAMES: -----------------
# note: INSTRUCTIONS:
# Definition to create our own line styles from the existing patterns in the model, a thickness, a name of choice and a color.
code_block = CodeBlock { "VP_1 Azul Discontinuo"; }
code_block_2 = CodeBlock { "VP_3 Rojo Centro"; }
code_block_3 = CodeBlock { "VP_6 Amarillo"; }
list_create = List.Create(item0=code_block, item1=code_block_2, item2=code_block_3)

# group: LINE WITH: ------------
code_block_4 = CodeBlock { 1; 3; 6; }
list_create_2 = List.Create(item0=code_block_4.out0, item1=code_block_4.out1, item2=code_block_4.out2)

# group: LINE PATTHERN: --------------------
line_patterns = LinePatterns("Trazo pequeño")
line_patterns_2 = LinePatterns("Trazo punto")
line_patterns_3 = LinePatterns("Punto")
list_create_3 = List.Create(item0=line_patterns, item1=line_patterns_2, item2=line_patterns_3)

# group: LINE COLORS: ------------
color_palette = ColorPalette({R: 0, G: 0, B: 128, A: 255})
color_palette_2 = ColorPalette({R: 255, G: 0, B: 0, A: 255})
color_palette_3 = ColorPalette({R: 255, G: 215, B: 0, A: 255})
list_create_4 = List.Create(item0=color_palette, item1=color_palette_2, item2=color_palette_3)

# note: Custom Node: BimorphNodes v.3.0.3
create = Revit.LineStyle.Create(name=list_create, weight=list_create_2, linePattern=list_create_3, color=list_create_4)
