# Dynamo graph APM_ParkingNumber-Spline.dyn (Dynamo 2.5.0.7460)

# group: SELECT MODEL LINE SPLINE: __________________________
# note: INSTRUCTIONS:
# Lists existing parking lots in a view from a spline drawn with model lines. It is designed for projects where there are parking spaces on a single level. It would have to be changed if not.
select_spline = DSModelElementSelection()  # 1 picked in the model

# group: Divide the spline in the way you have at least one point in each parking family: ______________________________________________________________________
curve = CurveElement.Curve(curveElement=select_spline)
number = DoubleInput(200)
pointsAtEqualSegmentLength = Curve.PointsAtEqualSegmentLength(curve=curve, divisions=number)

# group: Select car parks. If there are parking lots in more than one view, the node must be changed: __________________________________
categories = Categories("OST_Parking")
all_elements_of_category = ElementsOfCategory(Category=categories)

views = Views("Nivel 2")
all_elements_of_category_in_view = ElementsOfCategoryInView(Category=categories, View=views)

# group (continued): Select car parks. If there are parking lots in more than one view, the node must be changed: __________________________________
boundingBox = Element.BoundingBox(element=all_elements_of_category_in_view)

contains = BoundingBox.Contains(boundingBox=boundingBox)  # unwired: point

# group: FILTERING: __________________________________
map = List.Map(list=pointsAtEqualSegmentLength, function=contains)
filterByBoolMask = List.FilterByBoolMask(list=all_elements_of_category)  # unwired: mask
map_2 = List.Map(list=map, function=filterByBoolMask.in)
flatten = List.Flatten(list=map_2)
uniqueItems = List.UniqueItems(list=flatten)

number_2 = DoubleInput(1)
count = List.Count(list=uniqueItems)
sequence = Sequence(start=number_2, amount=count, step=number_2)

# group: TO REVIT: _______________
string = StringInput("Marca")
string_2 = StringInput("PLZ")
add = string_2 + sequence
setParameterByName = Element.SetParameterByName(element=uniqueItems, parameterName=string, value=add)
