# Dynamo graph APM_PlanViewsCreation.dyn (Dynamo 2.5.0.7460)

# group: SELECT ALL LEVELS IN THE PROJECT: -------------
categories = Categories("OST_Levels")
all_elements_of_category = ElementsOfCategory(Category=categories)

# group: CREATE PLAN VIEWS: ------------
byLevel = FloorPlanView.ByLevel(level=all_elements_of_category)

# group: CREATE CEILING PLAN VIEWS: -------------
byLevel_2 = CeilingPlanView.ByLevel(level=all_elements_of_category)
