# Dynamo graph APM_ProjectInfo-Excel.dyn (Dynamo 2.5.0.7460)

element_types = ElementTypes("ProjectInfo")
all_elements_of_type = ElementsOfType(element_type=element_types)

# group: IMPORT FROM EXCEL: -------------------------
# note: INSTRUCTIONS:
# Write the project information data into the project, previously written in an Excel. It´s practical when it had to be done for several models.
search_excel_file_with_project = Filename("C:\Users\Adriana\Google Drive\00 Expedientes\175 Albina Murieva  y Saad La Mairena\1.- Documentos y estudios del proyecto, parcela y fotos\175_Informacion Proyecto.xlsx")  # "Search Excel File with Project Info"; graph input
file_from_path = FileObject(path=search_excel_file_with_project)
excel_sheet_name = StringInput("SHEET 1")  # graph input
boolean = BoolSelector(true)
importExcel = Data.ImportExcel(file=file_from_path, sheetName=excel_sheet_name, readAsStrings=boolean)

restOfItems = List.RestOfItems(list=importExcel)
transpose = List.Transpose(lists=restOfItems)
code_block = CodeBlock { 0; }
getItemAtIndex = List.GetItemAtIndex(list=transpose, index=code_block)
code_block_2 = CodeBlock { 1; }
getItemAtIndex_2 = List.GetItemAtIndex(list=transpose, index=code_block_2)

# group: TO REVIT: -----------
setParameterByName = Element.SetParameterByName(element=all_elements_of_type, parameterName=getItemAtIndex, value=getItemAtIndex_2, lacing=Longest)
