# Dynamo graph APM_RenameViews.dyn (Dynamo 2.5.0.7460)

# group: SELECT ALL THE VIEWS IN THE PROJECT: ----------------------------
# note: INSTRUCTIONS:
# Renames plant views by adding a prefix, sufix or replacing some parts of the view name. It may be more practical with a plugin like DiRoots.
element_types = ElementTypes("ViewPlan")
all_elements_of_type = ElementsOfType(element_type=element_types)

# group: FILTER VIEWS: ----------------
code_block = CodeBlock { 1..20; }
getItemAtIndex = List.GetItemAtIndex(list=all_elements_of_type, index=code_block)

parameter_name = StringInput("Nombre de vista")
getParameterValueByName = Element.GetParameterValueByName(element=getItemAtIndex, parameterName=parameter_name)

# group: ADDING A PREFIX: -------------------
prefix = StringInput("Floor Plans_")  # graph input
code_block_2 = CodeBlock(Prefix=prefix, Name=getParameterValueByName) { Prefix + Name; }

# group: TO REVIT: ----------
setParameterByName = Element.SetParameterByName(element=getItemAtIndex, parameterName=parameter_name, value=code_block_2)

# group: CHANGE PARTS OF THE VIEW NAME: -----------------------
letters_to_replace = StringInput("")  # graph input
new_letters = StringInput("")  # graph input
replace = String.Replace(str=getParameterValueByName, searchFor=letters_to_replace, replaceWith=new_letters)

# group: ADDING A SUFIX: -------------------
sufix = StringInput("")  # graph input
code_block_3 = CodeBlock(Name=getParameterValueByName, Sufix=sufix) { Name + Sufix; }

code_block_4 = CodeBlock { "Tipo"; }
parameterByName = Parameter.ParameterByName(element=all_elements_of_type, name=code_block_4)
