# Dynamo graph APM_ScaleToSchedule.dyn (Dynamo 2.5.0.7460)

# note: INSTRUCTIONS:
# 1- Create sheets schedule.
# 2- Create the "Scale-schedule" parameter
# 3- Execute definition.
# The Scale parameter of the planes is placed in the new parameter created
sheets = Categories("OST_Sheets")
all_elements_of_category = ElementsOfCategory(Category=sheets)
parameter_scale_created = CodeBlock { "Scale-schedule"; }
code_block = CodeBlock { "Escala"; }
getParameterValueByName = Element.GetParameterValueByName(element=all_elements_of_category, parameterName=code_block)
setParameterByName = Element.SetParameterByName(element=all_elements_of_category, parameterName=parameter_scale_created, value=getParameterValueByName)
