# Dynamo graph APM_SheetRename.dyn "Renumerando-Planos" (Dynamo 2.5.0.7460)

# group: SELECT ALL THE SHEET IN THE MODEL: ----------
categories = Categories("OST_Sheets")  # graph input
all_elements_of_category = ElementsOfCategory(Category=categories)

# group: ORDERING SHEETS: -------------------
sheetNumber = Sheet.SheetNumber()  # unwired: sheet
sortByFunction = List.SortByFunction(list=all_elements_of_category, func=sheetNumber)
sheetNumber_2 = Sheet.SheetNumber(sheet=sortByFunction)

# group: SPLIT SHEETS LIST: --------------
code_block = CodeBlock { 11; 20; 1; }
slice = List.Slice(list=sortByFunction, start=code_block.out0, end=code_block.out1, step=code_block.out2)

code_block_2 = CodeBlock { "Número de plano"; }

# group: SHEET NUMBER SEQUENCE: -------------------------
code_block_3 = CodeBlock { 110; 1; }
count = List.Count(list=slice)
add = code_block_3.out0 + count
range = Range(start=code_block_3.out0, end=add, step=code_block_3.out1)

# group: PREFIX: ---------
string_from_object = FromObject(obj=range)
code_block_4 = CodeBlock { 0; "A-"; }
insert = String.Insert(str=string_from_object, index=code_block_4.out0, toInsert=code_block_4.out1)

setParameterByName = Element.SetParameterByName(element=slice, parameterName=code_block_2, value=insert)
