# Dynamo graph APM_SheetsCreation.dyn (Dynamo 2.5.0.7460)

# group: SELECT ALL VIEWS IN THE PROJECT: ---------------
categories = Categories("OST_Views")
all_elements_of_category = ElementsOfCategory(Category=categories)

# group: FILTER VIEWS: ---------------
code_block = CodeBlock { 8..47; }
views = List.GetItemAtIndex(list=all_elements_of_category, index=code_block)

# group: FILTERING TYPES OF VIEWS: ----------------
name = Element.Name(element=views)
code_block_2 = CodeBlock { 0..19; }
getItemAtIndex = List.GetItemAtIndex(list=name, index=code_block_2)
code_block_3 = CodeBlock { 20..39; }
getItemAtIndex_2 = List.GetItemAtIndex(list=name, index=code_block_3)

# group: LIST NAME: ------------
code_block_4 = CodeBlock(nombre=getItemAtIndex) { "DIST_"+ nombre; }
code_block_5 = CodeBlock(nombre=getItemAtIndex_2) { "RCP_"+ nombre; }
list_create = List.Create(item0=code_block_4, item1=code_block_5)
flatten = List.Flatten(list=list_create)

# group: SHEETS NUMBERS: ------------------------
code_block_6 = CodeBlock { "A_"; }
code_block_7 = CodeBlock { 101; }
count = List.Count(list=getItemAtIndex)
code_block_8 = CodeBlock { 1; }
sequence = Sequence(start=code_block_7, amount=count, step=code_block_8)
add = code_block_6 + sequence
code_block_9 = CodeBlock { "B_"; }
count_2 = List.Count(list=getItemAtIndex_2)
sequence_2 = Sequence(start=code_block_7, amount=count_2, step=code_block_8)
add_2 = code_block_9 + sequence_2
list_create_2 = List.Create(item0=add, item1=add_2)
flatten_2 = List.Flatten(list=list_create_2)

family_types = FamilyTypes("A0 métrico:A0 métrico")

# group: TO REVIT creating sheets: -------------
byNameNumberTitleBlockAndView = Sheet.ByNameNumberTitleBlockAndView(sheetName=flatten, sheetNumber=flatten_2, titleBlockFamilyType=family_types, view=views)
