# Dynamo graph APM_ViewsToNewSheets.dyn "Colocar-VistasPlanosNuevos" (Dynamo 2.5.0.7460)
# packages: archi-lab.net 2023.213.1722

# group: SELECT VIEW TYPE: -----------------
# note: INSTRUCTIONS:
# Definition created to place existing views to new sheets. Using the view names to named our sheets and creating the sheet numbers with a prefix + the sequence of views.
view_type = ViewTypesUi("Elevation")  # graph input
getByType = archilab.Revit.Views.Views.GetByType(viewType=view_type)

# group: SHEETS NAME: --------------
name = Element.Name(element=getByType)

# group: # OF VIEWS: --------
count = List.Count(list=getByType)

# group: SHEET NUMBER: ---------------
sheet_number_code = StringInput("CODE_")  # graph input
code_block = CodeBlock(num=count) { [1..num]; }
add = sheet_number_code + code_block

family_types = FamilyTypes("E1 30 x 42 Horizontal:E1 30x42 Horizontal")

# group: CREATE SHEETS: ------------
byNameNumberTitleBlockAndView = Sheet.ByNameNumberTitleBlockAndView(sheetName=name, sheetNumber=add, titleBlockFamilyType=family_types)  # graph output; unwired: view
