# Dynamo graph APM_ViewsToSheets.dyn (Dynamo 2.5.0.7460)
# packages: SteamNodes 1.2.4, archi-lab.net 2023.213.1722

# group: SELECT ALL SHEETS IN THE MODEL: ----------------
categories = Categories("OST_Sheets")
all_elements_of_category = ElementsOfCategory(Category=categories)

# group: SELECT VIEWS BY TYPE: ______________________
# note: Custom Node: archilab v.2023.213.1722
view_type = ViewTypesUi("FloorPlan")
getByType = archilab.Revit.Views.Views.GetByType(viewType=view_type)

code_block = CodeBlock { 3; 1; 2; 0; }
list_create = List.Create(item0=code_block.out0, item1=code_block.out1, item2=code_block.out2, item3=code_block.out3)
reorder = List.Reorder(list=getByType, indices=list_create)

# group: POINTS: ----------- _____________
code_block_2 = CodeBlock { 0; }
byCoordinates = Point.ByCoordinates(x=code_block_2, y=code_block_2)
count = List.Count(list=reorder)
ofRepeatedItem = List.OfRepeatedItem(item=byCoordinates, amount=count)

# group: TO REVIT: -------------
# note: Custom Node: SteamNodes v.1.2.4
placeViewsOnExistingSheets = Custom[Tool.PlaceViewsOnExistingSheets](Sheet=all_elements_of_category, View=reorder, ofRepeatedItem)  # package SteamNodes; Place the views on the sheets at the points you provide.

# group: FILTER SHEETS (if needed): -------------------
name = Element.Name(element=all_elements_of_category)
code_block_3 = CodeBlock { "FALSOS TECHOS"; }
contains = String.Contains(str=name, searchFor=code_block_3)
filterByBoolMask = List.FilterByBoolMask(list=all_elements_of_category, mask=contains)
