# Dynamo graph APM_WallsTags.dyn (Dynamo 2.5.0.7460)
# packages: spring nodes 204.1.0, LunchBox for Dynamo 2018.7.6

current = Document.Current()
# note: Custom Node: spring nodesv.204.1.0
ꟿ_document_activeview = Custom[ꟿ Document.ActiveView](refresh=current)  # package spring nodes; Selects the current document's active view. Supports more view types than the built-in option. Will be depreciated once the bult in node works with all plan types.

# group: GET ALL WALLS IN ACTIVE VIEW: --------------------
# note: INSTRUCCIONES:
# Definición creada para colocar etiqueta de todos los muros de la vista abierta de manera que estén a cierta distancia del muro y no lo pise, como etiqueta por defecto Revit.
all_elements_in_active_view = ElementsInView()
getCategory = Element.GetCategory(element=all_elements_in_active_view)
string_from_object = FromObject(obj=getCategory)
category = StringInput("Muros")  # graph input
eq = string_from_object == category

# group: GET ALL THE WALLS LOCATIONS: ---------------
filterByBoolMask = List.FilterByBoolMask(list=all_elements_in_active_view, mask=eq)
getLocation = Element.GetLocation(element=filterByBoolMask.in)

# group: DISTANCE FROM WALLS: ---------------------
posición_en_x = DoubleSlider(0.5, range=0..1 step 0.1)
pointAtParameter = Curve.PointAtParameter(curve=getLocation, param=posición_en_x)
code_block = CodeBlock { 0.5; }
normalAtParameter = Curve.NormalAtParameter(curve=getLocation, param=code_block)
posición_en_y = DoubleSlider(0.2, range=0..1 step 0.1)

# note: Custom Node: LunchBox
lunchbox_vector_amplitude = Custom[LunchBox Vector Amplitude](normalAtParameter, Amplitude=posición_en_y)  # package LunchBox for Dynamo; Set the amplitude of a vector.
translate = Geometry.Translate(geometry=pointAtParameter, direction=lunchbox_vector_amplitude)

# group: TAG: ------
byElementAndLocation = Tag.ByElementAndLocation(view=ꟿ_document_activeview, element=filterByBoolMask.in, location=translate)
