# Dynamo graph Crear-Vistas_2023.dyn (Dynamo 2.13.1.3887)

# note: CREA VISTAS A PARTIR DE ARCHIVO DE EXCEL Y LO ORGANIZA EN EL NAVEGADOR DE PROYECTOS SEGÚN LOS PARÁMETROS DE LA PLANTILLA.
# •  •  •  •  •  •  •  •  •  •  •  •  •  •  •  •  •  •  •  •  •  •
# 1- Crear las vistas en un archivo de Excel.
# 2- Crear niveles en el archivo de excel.
# 2- Crear los parámetros de organización del Navegador de proyectos.
# Hay que crear previamente unos parámetros compartidos que servirán para clasificar las vistas y organizar el navegador de proyectos.
file_path = Filename("C:\Users\pesta\OneDrive\Documentos\AM_CreacionVistas.xlsx")

# group: OBTENER DATOS DE LA HOJA NIVELES
file_from_path = FileObject(path=file_path)
# note: Nombre de la pestaña de excel con los nombres de niveles
code_block = CodeBlock { "NIVELES"; }
importExcel = Data.ImportExcel(file=file_from_path, sheetName=code_block)
restOfItems = List.RestOfItems(list=importExcel)
transpose = List.Transpose(lists=restOfItems)

# group: CREACIÓN DE NIVELES A PARTIR DE EXCEL
code_block_2 = CodeBlock { 1; }
getItemAtIndex = List.GetItemAtIndex(list=transpose, index=code_block_2)
code_block_3 = CodeBlock { 0; }
getItemAtIndex_2 = List.GetItemAtIndex(list=transpose, index=code_block_3)
byElevationAndName = Level.ByElevationAndName(elevation=getItemAtIndex, name=getItemAtIndex_2)

# group: DATOS DE LA HOJA VISTAS DE PLANTA
file_from_path_2 = FileObject(path=file_path)
# note: Nombre de la pestaña de excel con los nombres de vistas
code_block_4 = CodeBlock { "VISTAS"; }
importExcel_2 = Data.ImportExcel(file=file_from_path_2, sheetName=code_block_4)  # graph output
restOfItems_2 = List.RestOfItems(list=importExcel_2)
transpose_2 = List.Transpose(lists=restOfItems_2)

# group: DESGLOSAR PARÁMETROS
code_block_5 = CodeBlock { 1; }
nombres_de_niveles = List.GetItemAtIndex(list=transpose_2, index=code_block_5)
code_block_6 = CodeBlock { 0; }
nombres_de_vistas = List.GetItemAtIndex(list=transpose_2, index=code_block_6)
code_block_7 = CodeBlock { 2; }
uso_de_vistas = List.GetItemAtIndex(list=transpose_2, index=code_block_7)
code_block_8 = CodeBlock { 3; }
fase = List.GetItemAtIndex(list=transpose_2, index=code_block_8)
code_block_9 = CodeBlock { 4; }
entrega_tipo = List.GetItemAtIndex(list=transpose_2, index=code_block_9)
code_block_10 = CodeBlock { 5; }
tipo_de_vistas = List.GetItemAtIndex(list=transpose_2, index=code_block_10)

indexOf = List.IndexOf(list=getItemAtIndex_2, element=nombres_de_niveles@L1)
getItemAtIndex_3 = List.GetItemAtIndex(list=byElevationAndName, index=indexOf)

# group: APLICARLE VALORES A LOS PARÁMETROS
byLevel = FloorPlanView.ByLevel(level=getItemAtIndex_3)
code_block_11 = CodeBlock { "Nombre de vista"; }
setParameterByName = Element.SetParameterByName(element=byLevel, parameterName=code_block_11, value=nombres_de_vistas)
# note: PARÁMETROS DE ORGANIZACIÓN DEL NAVEGADOR DE PROYECTOS
parámetro_creado = CodeBlock { "AM_Navegador_Uso Vista"; }
setParameterByName_2 = Element.SetParameterByName(element=byLevel, parameterName=parámetro_creado, value=uso_de_vistas)
parámetro_creado_2 = CodeBlock { "AM_Navegador_Fase"; }
setParameterByName_3 = Element.SetParameterByName(element=byLevel, parameterName=parámetro_creado_2, value=fase)
parámetro_creado_3 = CodeBlock { "AM_Navegador_Entregar"; }
setParameterByName_4 = Element.SetParameterByName(element=byLevel, parameterName=parámetro_creado_3, value=entrega_tipo)
parámetro_creado_4 = CodeBlock { "AM_Navegador_Tipo de vista"; }
setParameterByName_5 = Element.SetParameterByName(element=byLevel, parameterName=parámetro_creado_4, value=tipo_de_vistas)
